# Grasshopper definition 01_simple_elastica.gh (Grasshopper 0.9.75)
# plug-ins: Marsupilami

pt = Point(<point referenced from the Rhino model>)
pt_2 = Point(<point referenced from the Rhino model>)
filter = StreamFilter(Gate=Toggle(False), Stream0=-1, Stream1=1)

l0 = Slider(20, range=0..20)
N = Slider(50, range=0..500)

addition = Addition(A=N, B=1)
division = Division(A=Slider(800, range=0..1000), B=addition)
multiplication = Multiplication(A=filter, B=division)
series = Series(Start=multiplication, Step=0, Count=expr("x+1", N))
vec = VectorXYZ(XComponent=0, YComponent=0, ZComponent=series)  # -> Vector, Length
ma = MassAddition(Input=vec.Vector)  # -> Result, PartialResults
simple_elastica = SimpleElastica(
    Point1=pt,
    Point2=pt_2,
    RestLength=l0,
    NumberOfElemnts=N,
    YoungsModulus=2.5e+10,
    CrossSectionArea=0.00042,
    AreaMomentOfInertia=7.8e-09,
    Fext=vec.Vector,
    Iteration_max="100000",
    Iterations_groupby="500",
    Reset=Toggle(False))  # -> Info, Xi, Xt, Vt, LMt, Rt, Fext, Ect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

# ---- group: OUTPUT
xt = Point(simple_elastica.Xt)
pline = PolyLine(Vertices=xt, Closed=False)
vdisex = VectorDisplayEx(Point=xt, Vector=expr("x/10", simple_elastica.Fext), Colour=RGB(0, 0, 0), Width=2)
xi = Point(simple_elastica.Xi)
N_2 = Number(simple_elastica.Nt)
T = Number(simple_elastica.Tt)
M = Number(simple_elastica.Mt)

# ---- group: DR INFOS
panel = Panel(simple_elastica.Info)
graph = QuickGraph(simple_elastica.Ect)

# ----
vec_2 = VectorXYZ(XComponent=expr("-x/2", 0), YComponent=0, ZComponent=0)  # -> Vector, Length

# ---- group: OUTPUT / OUTPUT : DISPLACEMENTS
vec2pt = Vector2Pt(PointA=flatten(xi), PointB=flatten(xt), Unitize=False)  # -> Vector, Length
msphere = MeshSphere(Base=flatten(xt), Radius=0.1, UCount=4, VCount=4)
devec = DeconstructVector(Vector=vec2pt.Vector)  # -> XComponent, YComponent, ZComponent
txt = Text(" mm")

list = ValueList({"Ux": 0, "Uy": 1, "Uz": 2, "U": 3}, selected="Uz")

filter_2 = StreamFilter(Gate=list, Stream0=devec.XComponent, Stream1=devec.YComponent, Stream2=devec.ZComponent, Stream3=vec2pt.Length)  # -> flatten(Stream)
num = Number(expr("x*1000", filter_2))
bnd = Bounds(Numbers=num)
dedomain = DeconstructDomain(Domain=bnd)  # -> Start, End
num_2 = Number(expr("Round(x,1)", dedomain.End))
num_3 = Number(expr("Round(x,1)", dedomain.Start))
filter_3 = StreamFilter(Gate=list, Stream0="Ux", Stream1="Uy", Stream2="Uz", Stream3="U")
concat = Concatenate(FragmentD=filter_3, FragmentA="(min) = ", FragmentB=num_3, FragmentC=txt)
concat_2 = Concatenate(FragmentD=filter_3, FragmentA="(max) = ", FragmentB=num_2, FragmentC=txt)

gradient = Gradient(
    LowerLimit=dedomain.Start,
    UpperLimit=dedomain.End,
    Parameter=num,
    stops=[0: RGB(18, 16, 20), 0: RGB(219, 90, 150), 0: RGB(0, 128, 0), 0.501: RGB(255, 255, 0), 1: RGB(255, 0, 0)])
bar_graph = BarGraph(filter_2, BarColor=RGB(255, 0, 90))

panel_2 = Panel(concat)
panel_3 = Panel(concat_2)
preview = CustomPreview(Geometry=msphere, Shader=gradient)

# ---- group: OUTPUT
list_2 = ValueList({"AXIAL FORCE": 0, "SHEAR FORCE": 1, "BENDING MOMENT": 2}, selected="BENDING MOMENT")

filter_4 = StreamFilter(Gate=list_2, Stream0=N_2, Stream1=T, Stream2=M)  # -> flatten(Stream)
explode = Explode(Curve=flatten(pline), Recursive=True)  # -> flatten(Segments), Vertices
num_4 = Number(filter_4)
bnd_2 = Bounds(Numbers=num_4)
dedomain_2 = DeconstructDomain(Domain=bnd_2)  # -> Start, End
num_5 = Number(expr("Round(x,1)", dedomain_2.Start))
num_6 = Number(expr("Round(x,1)", dedomain_2.End))
filter_5 = StreamFilter(Gate=list_2, Stream0=" N", Stream1=" N", Stream2=" Nm")
filter_6 = StreamFilter(Gate=list_2, Stream0="N", Stream1="T", Stream2="M")
concat_3 = Concatenate(FragmentD=filter_6, FragmentA="(min) = ", FragmentB=num_5, FragmentC=filter_5)
concat_4 = Concatenate(FragmentD=filter_6, FragmentA="(max) = ", FragmentB=num_6, FragmentC=filter_5)

gradient_2 = Gradient(
    LowerLimit=dedomain_2.Start,
    UpperLimit=dedomain_2.End,
    Parameter=expr("1.001*x", num_4),
    stops=[0: RGB(18, 16, 20), 0: RGB(219, 90, 150), 0: RGB(0, 128, 0), 0.501: RGB(255, 255, 0), 1: RGB(255, 0, 0)])
bar_graph_2 = BarGraph(filter_4, BarColor=RGB(255, 0, 90))

panel_4 = Panel(concat_3)
panel_5 = Panel(concat_4)
preview_2 = CustomPreview(Geometry=explode.Segments, Shader=gradient_2)

# ----
xt_2 = Point(simple_elastica.Xt)
intcrv = Interpolate(Vertices=xt_2, Degree=3, Periodic=False, KnotStyle=1)  # -> reparameterize(Curve), Length, Domain
crv_cp = CurveClosestPoint(Point=xt_2, Curve=intcrv.Curve)  # -> Point, Parameter, Distance
cull_i = CullIndex(List=crv_cp.Parameter, Indices=-1, Wrap=True)
shift = ShiftList(List=crv_cp.Parameter, Shift=1, Wrap=False)
dom = ConstructDomain(DomainStart=cull_i, DomainEnd=shift)
subcrv = SubCurve(BaseCurve=intcrv.Curve, Domain=dom)

move = Move(Geometry=subcrv, Motion=vec_2.Vector)  # -> Geometry, Transform

pipe = Pipe(Curve=move.Geometry, Radius=0.05, Caps=0)  # -> flatten(Pipe)
preview_3 = CustomPreview(Geometry=pipe, Shader=gradient_2)

material = CreateMaterial(Diffuse=gradient_2, Specular=RGB(255, 255, 255), Emission=RGB(0, 0, 0), Transparency=0, Shine=0)
c_script = CSharpScript(geometry=pipe, material=material, activate=Toggle(True), filePath="C:/try/")  # -> out; inputs geometry: list of GeometryBase, material: list, layers: list of String, activate: Boolean, current: Int32, filePath: String; disabled
# ---------- c_script: C# ----------
    if(!activate) return;

    List<Guid> guids = new List<Guid>();

    for(int i = 0; i < geometry.Count; i++){

      Rhino.DocObjects.ObjectAttributes att = new Rhino.DocObjects.ObjectAttributes();

      Rhino.Display.DisplayMaterial shader = new Rhino.Display.DisplayMaterial();

      if(material.Count == geometry.Count){
        shader = (Rhino.Display.DisplayMaterial) material[i];
      }else if(material.Count > 0){
        shader = (Rhino.Display.DisplayMaterial) material[0];
      }

      Rhino.DocObjects.Material mat = new Rhino.DocObjects.Material();

      mat.AmbientColor = shader.Ambient;
      mat.DiffuseColor = shader.Diffuse;
      mat.EmissionColor = shader.Emission;
      mat.Shine = shader.Shine;
      mat.SpecularColor = shader.Specular;
      mat.Transparency = shader.Transparency;

      string shaderName = string.Format("D{0}-E{1}-S{2}-Sp{3}-T{4}",
        shader.Diffuse.Name,
        shader.Emission.Name,
        shader.Shine,
        shader.Specular,
        shader.Transparency
        );

      mat.Name = shaderName;

      int nwMat = doc.Materials.Find(shaderName, true);
      if(nwMat < 0) nwMat = doc.Materials.Add(mat);

      Print(nwMat.ToString());

      string layer = "";

      if(layers.Count == geometry.Count){
        layer = layers[i];
      }else if(layers.Count > 0){
        layer = layers[0];
      }

      if(layer.Length == 0){
        att.MaterialSource = Rhino.DocObjects.ObjectMaterialSource.MaterialFromObject;
        att.MaterialIndex = nwMat;
        att.LayerIndex = doc.Layers.Find(doc.Layers.CurrentLayer.Id, true);
      }else{
        att.MaterialSource = Rhino.DocObjects.ObjectMaterialSource.MaterialFromLayer;
        int layInd = doc.Layers.Find(layer, true);
        if(layInd < 0){
          Rhino.DocObjects.Layer l = new Rhino.DocObjects.Layer();
          l.Color = mat.DiffuseColor;
          l.Name = layer;
          l.RenderMaterialIndex = nwMat;
          layInd = doc.Layers.Add(l);
        }
        att.LayerIndex = layInd;
      }

      Guid id = Guid.Empty;

      if(geometry[i].ObjectType == Rhino.DocObjects.ObjectType.Brep) id = doc.Objects.AddBrep((Brep) geometry[i], att);
      if(geometry[i].ObjectType == Rhino.DocObjects.ObjectType.Surface) id = doc.Objects.AddSurface((Surface) geometry[i], att);
      if(geometry[i].ObjectType == Rhino.DocObjects.ObjectType.Mesh) id = doc.Objects.AddMesh((Mesh) geometry[i], att);

      if(id.ToString().Length > 0) guids.Add(id);

    }

    string savedLocation = filePath + "\\r" + current.ToString("0000000") + ".jpg";

    Rhino.RhinoApp.RunScript("_-Render", false);
    Rhino.RhinoApp.RunScript("_-SaveRenderWindowAs \n\"" + savedLocation + "\"\n", false);
    Rhino.RhinoApp.RunScript("_-CloseRenderWindow", false);

    for(int i = 0; i < guids.Count; i++) doc.Objects.Delete(guids[i], true);
# ---------- end c_script ----------
