# Grasshopper definition 03_grid_surface_attraction.gh (Grasshopper 0.9.76)
# plug-ins: Marsupilami

# ----
# README
# INPUT
# 
# H : liste de polylines dans la direction H
# V : liste de polylines dans la direction V
# srf : surface d'attraction
# pts : liste de points attracteurs
# k : liste des raideurs des attracteurs
# E : module d'young des poutres de la grille
# S : section de's poutres de la grille
# I : inertie des poutres de la grille
# fz : force nodale appliquée en tous les noeuds de la direction H
# 
# N_max : nombre max d'itérations
# N_refresh : nombre d'itération avant rafraîchissement de l'affichage
# Reset : relance le calcul
crv = Curve([<curve referenced from the Rhino model> x14])
crv_2 = Curve([<curve referenced from the Rhino model> x14])
srf = Surface(<surface referenced from the Rhino model>)
pt = Point([<point referenced from the Rhino model> x5])
num = Number([1000, 1000, 1000, 1000, 250])
fz = Slider(-5, range=-100..0)

grid_attraction = _2DGridAttraction(
    PolylinesH=crv,
    PolylinesV=crv_2,
    Surface=srf,
    AttractionPoint=pt,
    AttractorStiffness=num,
    YoungsModulus=2.5e+10,
    CrossSectionArea=0.00042,
    AreaMomentOfInertia=7.9e-08,
    VerticalForce=fz,
    Iteration_max="60000",
    Iterations_groupby="500",
    Reset=Toggle(False))  # -> Info, Xi, Xt, Vt, LMt, Rt, Fext, Ect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

# ---- group: DR INFOS
# Une grille est définie par 2 listes de polylines H et V.
# 
# Le composant créé automatiquement une lisaison rotule entre un point de contôle de la direction H et un point de contrôle de la direction V  si ces points sont confondus.
# 
# La liste de "pts" permet de définir (dans la configuration initiale de la grille) quels sont les noeuds qui seront attirés sur la surface.
# 
# Pour chaque point attiré sur la surface, définir la raideur correspondante dans la liste "k".
panel = Panel(grid_attraction.Info)
graph = QuickGraph()

# ---- group: OUTPUT
xi = Point(grid_attraction.Xi)
xt = Point(grid_attraction.Xt)
pline = PolyLine(Vertices=xt, Closed=False)
vdisex = VectorDisplayEx(Point=xt, Vector=expr("x/10", grid_attraction.Fext), Colour=RGB(0, 0, 0), Width=2)
N = Number(grid_attraction.Nt)
T = Number(grid_attraction.Tt)
M = Number(grid_attraction.Mt)

# ---- group: OUTPUT / OUTPUT : DISPLACEMENTS
vec2pt = Vector2Pt(PointA=flatten(xi), PointB=flatten(xt), Unitize=False)  # -> Vector, Length
msphere = MeshSphere(Base=flatten(xt), Radius=0.1, UCount=4, VCount=4)
devec = DeconstructVector(Vector=vec2pt.Vector)  # -> XComponent, YComponent, ZComponent
txt = Text(" mm")

list = ValueList({"Ux": 0, "Uy": 1, "Uz": 2, "U": 3}, selected="Uz")

filter = StreamFilter(Gate=list, Stream0=devec.XComponent, Stream1=devec.YComponent, Stream2=devec.ZComponent, Stream3=vec2pt.Length)  # -> flatten(Stream)
num_2 = Number(expr("x*1000", filter))
bnd = Bounds(Numbers=num_2)
dedomain = DeconstructDomain(Domain=bnd)  # -> Start, End
num_3 = Number(expr("Round(x,1)", dedomain.Start))
num_4 = Number(expr("Round(x,1)", dedomain.End))
filter_2 = StreamFilter(Gate=list, Stream0="Ux", Stream1="Uy", Stream2="Uz", Stream3="U")
concat = Concatenate(FragmentD=filter_2, FragmentA="(min) = ", FragmentB=num_3, FragmentC=txt)
concat_2 = Concatenate(FragmentD=filter_2, FragmentA="(max) = ", FragmentB=num_4, FragmentC=txt)

gradient = Gradient(
    LowerLimit=dedomain.Start,
    UpperLimit=dedomain.End,
    Parameter=num_2,
    stops=[0: RGB(18, 16, 20), 0: RGB(219, 90, 150), 0: RGB(0, 128, 0), 0.501: RGB(255, 255, 0), 1: RGB(255, 0, 0)])
bar_graph = BarGraph(filter, BarColor=RGB(255, 0, 90))

panel_2 = Panel(concat)
panel_3 = Panel(concat_2)
preview = CustomPreview(Geometry=msphere, Shader=gradient)

# ---- group: OUTPUT
list_2 = ValueList({"AXIAL FORCE": 0, "SHEAR FORCE": 1, "BENDING MOMENT": 2}, selected="BENDING MOMENT")

filter_3 = StreamFilter(Gate=list_2, Stream0=N, Stream1=T, Stream2=M)  # -> flatten(Stream)
explode = Explode(Curve=flatten(pline), Recursive=True)  # -> flatten(Segments), Vertices
num_5 = Number(filter_3)
bnd_2 = Bounds(Numbers=num_5)
dedomain_2 = DeconstructDomain(Domain=bnd_2)  # -> Start, End
num_6 = Number(expr("Round(x,1)", dedomain_2.Start))
num_7 = Number(expr("Round(x,1)", dedomain_2.End))
filter_4 = StreamFilter(Gate=list_2, Stream0=" N", Stream1=" N", Stream2=" Nm")
filter_5 = StreamFilter(Gate=list_2, Stream0="N", Stream1="T", Stream2="M")
concat_3 = Concatenate(FragmentD=filter_5, FragmentA="(min) = ", FragmentB=num_6, FragmentC=filter_4)
concat_4 = Concatenate(FragmentD=filter_5, FragmentA="(max) = ", FragmentB=num_7, FragmentC=filter_4)

gradient_2 = Gradient(
    LowerLimit=dedomain_2.Start,
    UpperLimit=dedomain_2.End,
    Parameter=expr("1.001*x", num_5),
    stops=[0: RGB(18, 16, 20), 0: RGB(219, 90, 150), 0: RGB(0, 128, 0), 0.501: RGB(255, 255, 0), 1: RGB(255, 0, 0)])
bar_graph_2 = BarGraph(filter_3, BarColor=RGB(255, 0, 90))

panel_4 = Panel(concat_3)
panel_5 = Panel(concat_4)
preview_2 = CustomPreview(Geometry=explode.Segments, Shader=gradient_2)
