# Grasshopper definition 04_patch_grid.gh (Grasshopper 0.9.76)
# plug-ins: Marsupilami

H = H(<h referenced from the Rhino model>)
V = V(<v referenced from the Rhino model>)
patch_grid = PatchGrid(H=H, V=V, Iteration_max="10000", Iterations_groupby="500", Reset=Toggle(True))  # -> Info, Xi, Xt, Vt, LMt, Rt, Fext, Ect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

# ---- group: OUTPUT
xt = Point(patch_grid.Xt)
pline = PolyLine(Vertices=xt, Closed=False)
vdisex = VectorDisplayEx(Point=xt, Colour=RGB(0, 0, 0), Width=2)
xi = Point(patch_grid.Xi)
N = Number(patch_grid.Nt)
T = Number(patch_grid.Tt)
M = Number(patch_grid.Mt)

# ---- group: DR INFOS
panel = Panel(patch_grid.Info)
graph = QuickGraph(patch_grid.Ect)

# ---- group: OUTPUT / OUTPUT : DISPLACEMENTS
vec2pt = Vector2Pt(PointA=flatten(xi), PointB=flatten(xt), Unitize=False)  # -> Vector, Length
msphere = MeshSphere(Base=flatten(xt), Radius=0.1, UCount=4, VCount=4)
devec = DeconstructVector(Vector=vec2pt.Vector)  # -> XComponent, YComponent, ZComponent
txt = Text(" mm")

list = ValueList({"Ux": 0, "Uy": 1, "Uz": 2, "U": 3}, selected="Uz")

filter = StreamFilter(Gate=list, Stream0=devec.XComponent, Stream1=devec.YComponent, Stream2=devec.ZComponent, Stream3=vec2pt.Length)  # -> flatten(Stream)
num = Number(expr("x*1000", filter))
bnd = Bounds(Numbers=num)
dedomain = DeconstructDomain(Domain=bnd)  # -> Start, End
num_2 = Number(expr("Round(x,1)", dedomain.End))
num_3 = Number(expr("Round(x,1)", dedomain.Start))
filter_2 = StreamFilter(Gate=list, Stream0="Ux", Stream1="Uy", Stream2="Uz", Stream3="U")
concat = Concatenate(FragmentD=filter_2, FragmentA="(min) = ", FragmentB=num_3, FragmentC=txt)
concat_2 = Concatenate(FragmentD=filter_2, FragmentA="(max) = ", FragmentB=num_2, FragmentC=txt)

gradient = Gradient(
    LowerLimit=dedomain.Start,
    UpperLimit=dedomain.End,
    Parameter=num,
    stops=[0: RGB(18, 16, 20), 0: RGB(219, 90, 150), 0: RGB(0, 128, 0), 0.501: RGB(255, 255, 0), 1: RGB(255, 0, 0)])
bar_graph = BarGraph(filter, BarColor=RGB(255, 0, 90))

panel_2 = Panel(concat)
panel_3 = Panel(concat_2)
preview = CustomPreview(Geometry=msphere, Shader=gradient)

# ---- group: OUTPUT
list_2 = ValueList({"AXIAL FORCE": 0, "SHEAR FORCE": 1, "BENDING MOMENT": 2}, selected="BENDING MOMENT")

filter_3 = StreamFilter(Gate=list_2, Stream0=N, Stream1=T, Stream2=M)  # -> flatten(Stream)
explode = Explode(Curve=flatten(pline), Recursive=True)  # -> flatten(Segments), Vertices
num_4 = Number(filter_3)
bnd_2 = Bounds(Numbers=num_4)
dedomain_2 = DeconstructDomain(Domain=bnd_2)  # -> Start, End
num_5 = Number(expr("Round(x,1)", dedomain_2.Start))
num_6 = Number(expr("Round(x,1)", dedomain_2.End))
filter_4 = StreamFilter(Gate=list_2, Stream0=" N", Stream1=" N", Stream2=" Nm")
filter_5 = StreamFilter(Gate=list_2, Stream0="N", Stream1="T", Stream2="M")
concat_3 = Concatenate(FragmentD=filter_5, FragmentA="(min) = ", FragmentB=num_5, FragmentC=filter_4)
concat_4 = Concatenate(FragmentD=filter_5, FragmentA="(max) = ", FragmentB=num_6, FragmentC=filter_4)

gradient_2 = Gradient(
    LowerLimit=dedomain_2.Start,
    UpperLimit=dedomain_2.End,
    Parameter=expr("1.001*x", num_4),
    stops=[0: RGB(18, 16, 20), 0: RGB(219, 90, 150), 0: RGB(0, 128, 0), 0.501: RGB(255, 255, 0), 1: RGB(255, 0, 0)])
bar_graph_2 = BarGraph(filter_3, BarColor=RGB(255, 0, 90))

panel_4 = Panel(concat_3)
panel_5 = Panel(concat_4)
preview_2 = CustomPreview(Geometry=explode.Segments, Shader=gradient_2)
