# Grasshopper definition 05_cable_net.gh (Grasshopper 0.9.76)
# plug-ins: Marsupilami

H = Curve([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])
V = Curve([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])
pt = Point([Point(10, -10, 0), Point(-10, -10, 0), Point(-10, 10, 0), Point(10, 10, 0)])
f = Slider(46.64, range=1..1000)
r = Slider(2, range=1..10)
cp = ControlPoints(Curve=H)  # -> simplify(Points), Weights, Knots
pow = Power(A=10, B=Slider(4, range=0..4))
es = Panel(pow)
nmax = Panel("10000")
nrefresh = Panel("100")
expression = Expression(pt=cp.Points, f=f, r=r, Expression="f * cos((pt.x*pt.x + pt.y*pt.y)^0.2/ r)")
Z = UnitZ(Factor=expression)
num = Number(flatten(Z))
bnd = Bounds(Numbers=num)
dedomain = DeconstructDomain(Domain=bnd)  # -> Start, End
cable_net = CableNet(H=H, V=V, SupportPoints=pt, AxialStiffnessES=es, Fext=Z, Iteration_max=nmax, Iterations_groupby=nrefresh, Reset=Button())  # -> Info, Xi, Xt, Vt, LMt, Rt, Fext, Ect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
division = Division(A=Z, B=dedomain.End)
vdis = VectorDisplay(Anchor=cp.Points, Vector=expr("5*x", division))
loading = Panel(expression)

# ---- group: DR INFOS
panel = Panel(cable_net.Info)
graph = QuickGraph(cable_net.Ect)

# ---- group: OUTPUT
xt = Point(cable_net.Xt)
pline = PolyLine(Vertices=xt, Closed=False)
vdisex = VectorDisplayEx(Point=xt, Colour=RGB(0, 0, 0), Width=2)
N = Number(cable_net.Nt)
T = Number(cable_net.Tt)
M = Number(cable_net.Mt)
xi = Point(cable_net.Xi)

# ---- group: OUTPUT / OUTPUT : DISPLACEMENTS
vec2pt = Vector2Pt(PointA=flatten(xi), PointB=flatten(xt), Unitize=False)  # -> Vector, Length
msphere = MeshSphere(Base=flatten(xt), Radius=0.1, UCount=4, VCount=4)
devec = DeconstructVector(Vector=vec2pt.Vector)  # -> XComponent, YComponent, ZComponent
txt = Text(" mm")

list = ValueList({"Ux": 0, "Uy": 1, "Uz": 2, "U": 3}, selected="Uz")

filter = StreamFilter(Gate=list, Stream0=devec.XComponent, Stream1=devec.YComponent, Stream2=devec.ZComponent, Stream3=vec2pt.Length)  # -> flatten(Stream)
num_2 = Number(expr("x*1000", filter))
bnd_2 = Bounds(Numbers=num_2)
dedomain_2 = DeconstructDomain(Domain=bnd_2)  # -> Start, End
num_3 = Number(expr("Round(x,1)", dedomain_2.Start))
num_4 = Number(expr("Round(x,1)", dedomain_2.End))
filter_2 = StreamFilter(Gate=list, Stream0="Ux", Stream1="Uy", Stream2="Uz", Stream3="U")
concat = Concatenate(FragmentD=filter_2, FragmentA="(min) = ", FragmentB=num_3, FragmentC=txt)
concat_2 = Concatenate(FragmentD=filter_2, FragmentA="(max) = ", FragmentB=num_4, FragmentC=txt)

gradient = Gradient(
    LowerLimit=dedomain_2.Start,
    UpperLimit=dedomain_2.End,
    Parameter=num_2,
    stops=[0: RGB(18, 16, 20), 0: RGB(219, 90, 150), 0: RGB(0, 128, 0), 0.501: RGB(255, 255, 0), 1: RGB(255, 0, 0)])
bar_graph = BarGraph(filter, BarColor=RGB(255, 0, 90))

panel_2 = Panel(concat)
panel_3 = Panel(concat_2)
preview = CustomPreview(Geometry=msphere, Shader=gradient)

# ---- group: OUTPUT
list_2 = ValueList({"AXIAL FORCE": 0, "SHEAR FORCE": 1, "BENDING MOMENT": 2}, selected="AXIAL FORCE")

filter_3 = StreamFilter(Gate=list_2, Stream0=N, Stream1=T, Stream2=M)  # -> flatten(Stream)
explode = Explode(Curve=flatten(pline), Recursive=True)  # -> flatten(Segments), Vertices
num_5 = Number(filter_3)
bnd_3 = Bounds(Numbers=num_5)
dedomain_3 = DeconstructDomain(Domain=bnd_3)  # -> Start, End
num_6 = Number(expr("Round(x,1)", dedomain_3.End))
num_7 = Number(expr("Round(x,1)", dedomain_3.Start))
filter_4 = StreamFilter(Gate=list_2, Stream0=" N", Stream1=" N", Stream2=" Nm")
filter_5 = StreamFilter(Gate=list_2, Stream0="N", Stream1="T", Stream2="M")
concat_3 = Concatenate(FragmentD=filter_5, FragmentA="(min) = ", FragmentB=num_7, FragmentC=filter_4)
concat_4 = Concatenate(FragmentD=filter_5, FragmentA="(max) = ", FragmentB=num_6, FragmentC=filter_4)

gradient_2 = Gradient(
    LowerLimit=dedomain_3.Start,
    UpperLimit=dedomain_3.End,
    Parameter=expr("1.001*x", num_5),
    stops=[0: RGB(18, 16, 20), 0: RGB(219, 90, 150), 0: RGB(0, 128, 0), 0.501: RGB(255, 255, 0), 1: RGB(255, 0, 0)])
bar_graph_2 = BarGraph(filter_3, BarColor=RGB(255, 0, 90))

panel_4 = Panel(concat_3)
panel_5 = Panel(concat_4)
preview_2 = CustomPreview(Geometry=explode.Segments, Shader=gradient_2)
